# Grasshopper definition Function_by_C#.gh (Grasshopper 1.0.7)

# Replace multiple string
panel_3 = Panel("""ABC
BCA
BBCA""")
panel_4 = Panel("""A
B
C""")
# Note: [Above]
# Original "Replace Text" can only replace one string with another.
# [Below]
# Replace multiple string with others.
panel_5 = Panel("""1
2
3""")
panel_6 = Panel("""ABC
BCA
BBCA""")
panel_7 = Panel("""A
B
C""")
panel_8 = Panel("""1
2
3""")
select_text_from_rhino = Guid()
substring = Panel("""BCD
12
EF""")
# Find substring
substr = CSharpScript(
    s1="ABCD123",
    s2=substring,
    TooltipDescriptionOverride="Find substring and return index, return -1 if substring is not found.",
    TooltipTextOverride="Find substring")  # -> i; inputs s1: String, s2: String
# ---------- substr: C# usings ----------
using System.Text.RegularExpressions;
# ---------- substr: C# ----------
    Match mc = Regex.Match(s1, s2);
    i = -1;
    if (mc.Success)
      i = mc.Index;
# ---------- end substr ----------
# Text
# Get Rhino text
gettext = CSharpScript(T=select_text_from_rhino, TooltipDescriptionOverride="Get text from Rhino", TooltipTextOverride="Get Text")  # -> S, P; inputs T: Guid
# ---------- gettext: C# usings ----------
using Rhino.DocObjects;
# ---------- gettext: C# ----------
    var doc = RhinoDoc.ActiveDoc;
    
    TextObject textObject;
    textObject = (TextObject) doc.Objects.Find(T);

    Plane plane = textObject.TextGeometry.Plane;
    plane.Origin = textObject.Geometry.GetBoundingBox(false).Center;

    S = textObject.DisplayText;
    P = plane;
# ---------- end gettext ----------
rep = ReplaceText(Text=panel_3, Find=panel_4, Replace=panel_5, RecursiveReplace=False)
multirep = CSharpScript(T=panel_6, F=panel_7, R=panel_8)  # -> S; inputs T: String, F: list of String, R: list of String
# ---------- multirep: C# ----------
    int n = F.Count;
    int i;
    string rs = T;
    for(i = 0;i < n;i++)
      rs = rs.Replace(F[i], R[i]);
    S = rs;
# ---------- end multirep ----------
substring_index = Panel(substr)
panel_9 = Panel(rep)
pln = Plane(gettext.P)
panel_10 = Panel(multirep)
string = Text(gettext.S)
# Note: The rectangle's size and position are measured in 'Pixels' and are unique to the viewport space instead of 3D model space.
# [Example]
# Viewport size=(640,480)
# Rectangle location=(0,0); size=(320,240)
# The rectangle occupy the upper left section of the viewport, comprising one-quarter of the total viewport area.
# Draw text on viewport 2D space
panel_12 = Panel("")
# Note: The dots' location are measured in Rhino document unit and are unique to the 3d model space instead of viewport space.
# Draw text with background rectangle
#  on viewport 2D space
panel_14 = Panel("")
# Note: The dot's position is measured in 'Pixels' and are unique to the viewport space instead of 3D model space.
# Draw dot on model 3D space
panel_15 = Panel("")
rectangle_height = Slider(40, range=0..100)
rectangle_height_2 = Slider(60, range=0..100)
rectangle_height_3 = Slider(33, range=0..100)
rectangle_width = Slider(100, range=0..100)
rectangle_width_2 = Slider(68, range=0..100)
# Display
# Draw rectangle on viewport 2D space
rectangle_screen_position = Panel("""100,200
300,200""")
rectangle_screen_position_2 = Panel("100,100")
# Draw dot on viewport 2D space
screen_position = Panel("""100,200
300,200""")
font_height = Slider(32, range=0..100)
middlejustified = BooleanToggle(True)
border_thickness = Slider(2, range=0..10)
fontheight = Slider(18, range=0..100)
border_thickness_2 = Slider(2, range=0..10)
point_3d = Panel("""1000,1000,1000
20000,20000,200""")
point2d = Panel("""200,200
200,400""")
text_color = ColourSwatch(SwatchColor=RGB(0, 0, 0))
dot_color = ColourSwatch(SwatchColor=RGB(255, 221, 0))
# Note: The rect position and text offset is measured in 'Pixels' and are unique to the viewport space instead of 3D model space.
# 
# Text offset represents X and Y distance between text top-left corner and rectangle top-left corner.
# 
# This component ensure rectangle background is drawn behind text.
font_height_2 = Slider(22, range=0..100)
font = Panel("Arial")
display_text = Panel("ABC")
text = Panel("AAA")
color = ColourSwatch(SwatchColor=RGB(0, 0, 0))
border_color = ColourSwatch(SwatchColor=RGB(255, 255, 255))
text_color_2 = ColourSwatch(SwatchColor=RGB(255, 221, 0))
fill_color = ColourSwatch(SwatchColor=RGB(0, 0, 0))
text_offset = Panel("10,10")
border_color_2 = ColourSwatch(SwatchColor=RGB(0, 0, 0))
rectangle_color = ColourSwatch(SwatchColor=RGBA(62, 125, 119, 145))
display_text_2 = Panel("ABC")
font_2 = Panel("Arial")
border_color_3 = ColourSwatch(SwatchColor=RGB(0, 0, 0))
text_2 = Panel("AAA")
font_3 = Panel("Arial")
infill_color = ColourSwatch(SwatchColor=RGBA(106, 125, 62, 145))
infill_color_2 = ColourSwatch(SwatchColor=RGBA(62, 125, 119, 145))
text_color_3 = ColourSwatch(SwatchColor=RGB(0, 0, 0))
rectangle = Rectangle(Plane=rectangle_screen_position_2, XSize=rectangle_width_2, YSize=rectangle_height_3, Radius=0)  # -> Rectangle, Length
rectangle_2 = Rectangle(Plane=rectangle_screen_position, XSize=rectangle_width, YSize=[rectangle_height, rectangle_height_2], Radius=0)  # -> Rectangle, Length
text2d = CSharpScript(
    T=display_text,
    P=point2d,
    C=color,
    H=font_height,
    M=middlejustified,
    F=font,
    TooltipDescriptionOverride="Draw 2D rectangle on active viewport",
    TooltipTextOverride="Draw rectangle")  # inputs T: String, P: Point3d, C: Color, H: Int32, M: Boolean, F: String
# ---------- text2d: C# usings ----------
using System.Drawing;
# ---------- text2d: C# ----------
    // Clears the list in the first iteration.
    if (this.Iteration == 0)
      t_list = new List<Text2D>();

    Text2D item = new Text2D
      {
        text = T,
        color = C,
        point2d = new Point2d(P.X, P.Y),
        middle = M,
        height = H,
        font = F
        };

    t_list.Add(item);
# ---------- text2d: C# additional code ----------
  private struct Text2D
  {
    public string text;
    public Color color;
    public Point2d point2d;
    public bool middle;
    public int height;
    public string font;
  }
  private List<Text2D> t_list;

  public override void DrawViewportWires(IGH_PreviewArgs args)
  {
    // This display override only runs once.
    // So a list must be used to transfer all data here, if there are multiple rectangles.

    for (int i = 0; i < t_list.Count; i++)
    {
      args.Display.Draw2dText(t_list[i].text, t_list[i].color, t_list[i].point2d, t_list[i].middle, t_list[i].height, t_list[i].font);
    }
  }
# ---------- end text2d ----------
dot2d = CSharpScript(
    L=screen_position,
    T=text,
    Ct=text_color,
    Cd=dot_color,
    TooltipDescriptionOverride="Draw 2D rectangle on active viewport",
    TooltipTextOverride="Draw rectangle")  # inputs L: Point3d, T: String, Ct: Color, Cd: Color
# ---------- dot2d: C# ----------
    // Clears the list in the first iteration.
    if (this.Iteration == 0)
      m_dot = new List<TextDots>();

    TextDots item = new TextDots
      {
        X = (float) L.X,
        Y = (float) L.Y,
        text = T,
        color_d = Cd,
        color_t = Ct
        };
    m_dot.Add(item);
# ---------- dot2d: C# additional code ----------
  private struct TextDots
  {
    public float X;
    public float Y;
    public string text;
    public Color color_d;
    public Color color_t;
  }
  private List<TextDots> m_dot;


  public override void DrawViewportWires(IGH_PreviewArgs args)
  {
    // This display override only runs once.
    // So a list must be used to transfer all data here, if there are multiple rectangles.

    for (int i = 0; i < m_dot.Count; i++)
    {
      args.Display.DrawDot(m_dot[i].X, m_dot[i].Y, m_dot[i].text, m_dot[i].color_d, m_dot[i].color_t);

    }
  }
# ---------- end dot2d ----------
rect2d = CSharpScript(
    R=rectangle_2.Rectangle,
    Cb=border_color_3,
    C=[infill_color_2, infill_color],
    T=border_thickness_2,
    TooltipDescriptionOverride="Draw 2D rectangle on active viewport",
    TooltipTextOverride="Draw rectangle")  # inputs R: Rectangle3d, Cb: Color, C: Color, T: Int32
# ---------- rect2d: C# ----------
    // Clears the list in the first iteration.
    if (this.Iteration == 0)
      m_rect = new List<Rectangle2D>();

    Rectangle2D item = new Rectangle2D
      {
        rect2d = new Rectangle((int) R.Corner(0).X, (int) R.Corner(0).Y, (int) R.Width, (int) R.Height),
        color_b = Cb,
        thk = T,
        color = C
        };

    m_rect.Add(item);
# ---------- rect2d: C# additional code ----------
  private struct Rectangle2D
  {
    public Rectangle rect2d;
    public Color color_b;
    public int thk;
    public Color color;
  }
  private List<Rectangle2D> m_rect;

  public override void DrawViewportWires(IGH_PreviewArgs args)
  {
    // This display override only runs once.
    // So a list must be used to transfer all data here, if there are multiple rectangles.

    for (int i = 0; i < m_rect.Count; i++)
    {
      args.Display.Draw2dRectangle(m_rect[i].rect2d, Color.Transparent, 0, m_rect[i].color);
      args.Display.Draw2dRectangle(m_rect[i].rect2d, m_rect[i].color_b, m_rect[i].thk, Color.Transparent);
    }
  }
# ---------- end rect2d ----------
dot3d = CSharpScript(
    L=point_3d,
    T=text_2,
    F=font_3,
    H=fontheight,
    C=fill_color,
    Ct=text_color_2,
    Cb=border_color,
    TooltipDescriptionOverride="Draw 2D rectangle on active viewport",
    TooltipTextOverride="Draw rectangle")  # inputs L: Point3d, T: String, F: String, H: Int32, C: Color, Ct: Color, Cb: Color
# ---------- dot3d: C# ----------
    // Clears the list in the first iteration.
    if (this.Iteration == 0)
      m_dot = new List<TextDots>();

    TextDots item = new TextDots
      {
        textdot = new TextDot(T, L),
        color = C,
        color_t = Ct,
        color_b = Cb
        };
    item.textdot.FontHeight = H;
    item.textdot.FontFace = F;
    m_dot.Add(item);
# ---------- dot3d: C# additional code ----------
  private struct TextDots
  {
    public TextDot textdot;
    public Color color;
    public Color color_t;
    public Color color_b;
  }
  private List<TextDots> m_dot;


  public override void DrawViewportWires(IGH_PreviewArgs args)
  {
    // This display override only runs once.
    // So a list must be used to transfer all data here, if there are multiple rectangles.

    for (int i = 0; i < m_dot.Count; i++)
    {
      args.Display.DrawDot(m_dot[i].textdot, m_dot[i].color, m_dot[i].color_t, m_dot[i].color_b);
    }
  }
# ---------- end dot3d ----------
textrect2d = CSharpScript(
    R=rectangle.Rectangle,
    O=text_offset,
    T=display_text_2,
    Cb=border_color_2,
    C=rectangle_color,
    W=border_thickness,
    Ct=text_color_3,
    F=font_2,
    H=font_height_2,
    TooltipDescriptionOverride="Draw 2D rectangle on active viewport",
    TooltipTextOverride="Draw rectangle")  # inputs R: Rectangle3d, O: Point3d, T: String, Cb: Color, C: Color, W: Int32, Ct: Color, F: String, H: Int32
# ---------- textrect2d: C# ----------
    // Clears the list in the first iteration.
    if (this.Iteration == 0)
      rt = new List<rectText>();

    rectText item = new rectText
      {
        rect2d = new Rectangle((int) R.Corner(0).X, (int) R.Corner(0).Y, (int) R.Width, (int) R.Height),
        color_b = Cb,
        thk = W,
        color = C,
        text = T,
        height = H,
        font = F,
        color_t = Ct,
        pt = new Point2d((int) (R.Corner(0).X + O.X), (int) (R.Corner(0).Y + O.Y))
        };

    rt.Add(item);
# ---------- textrect2d: C# additional code ----------
  private struct rectText
  {
    public Rectangle rect2d;
    public Color color_b;
    public int thk;
    public Color color;
    public string text;
    public Color color_t;
    public string font;
    public int height;
    public Point2d pt;
  }
  private List<rectText> rt;

  public override void DrawViewportWires(IGH_PreviewArgs args)
  {
    // This display override only runs once.
    // So a list must be used to transfer all data here, if there are multiple rectangles.

    for (int i = 0; i < rt.Count; i++)
    {
      args.Display.Draw2dRectangle(rt[i].rect2d, Color.Transparent, 0, rt[i].color);
      args.Display.Draw2dRectangle(rt[i].rect2d, rt[i].color_b, rt[i].thk, Color.Transparent);
      args.Display.Draw2dText(rt[i].text, rt[i].color_t, rt[i].pt, false, rt[i].height, rt[i].font);
    }
  }
# ---------- end textrect2d ----------
# Display
panel_16 = Panel("")
arrow_thickness = Slider(2, range=0..10)
# Arrow size ratio: Arrow size ratio = Arrow size/Arrow length.
# 
# [Example]
# Arrow length = 1000mm
# Arrow size ratio = 0.3
# Arrow size = 1000mm*0.3=300mm
arrow_size_ratio = Slider(0.17, range=0..1)
# Display plane XYZ axis.
arrow_length = Slider(100, range=0..100)
plane_to_display = Plane(Plane(origin=(0, 0, 0), x=(0.8035742236, 0.595204559, 0), y=(-0.3684599416, 0.4974506781, 0.7853534836)))
displayplane = CSharpScript(P=plane_to_display, L=arrow_length, T=arrow_thickness, A=arrow_size_ratio)  # inputs P: Plane, L: Double, T: Int32, A: Double
# ---------- displayplane: C# ----------
    if (this.Iteration == 0)
    {
      m_planevector = new List<PlaneVector>();
    }
    PlaneVector item = new PlaneVector
      {
        line_x = new Line(P.Origin, P.XAxis, L),
        line_y = new Line(P.Origin, P.YAxis, L),
        line_z = new Line(P.Origin, P.ZAxis, L),
        length = L,
        thickness = T,
        arrow = A * L
        };
    m_planevector.Add(item);
# ---------- displayplane: C# additional code ----------
  private struct PlaneVector
  {
    public Line line_x;
    public Line line_y;
    public Line line_z;
    public double length;
    public int thickness;
    public double arrow;
  }
  private List<PlaneVector> m_planevector;

  public override void DrawViewportWires(IGH_PreviewArgs args)
  {
    int num = m_planevector.Count;
    for (int i = 0; i < num; i++)
    {
      args.Display.DrawLineArrow(m_planevector[i].line_x, System.Drawing.Color.Red, m_planevector[i].thickness, m_planevector[i].arrow);
      args.Display.DrawLineArrow(m_planevector[i].line_y, System.Drawing.Color.Green, m_planevector[i].thickness, m_planevector[i].arrow);
      args.Display.DrawLineArrow(m_planevector[i].line_z, System.Drawing.Color.Blue, m_planevector[i].thickness, m_planevector[i].arrow);
    }
  }
# ---------- end displayplane ----------
# Surface
panel_17 = Panel("")
list = ValueList({"ShrinkAllSides": 0, "DoNotShrinkWestSide": 1, "DoNotShrinkSouthSide": 2, "DoNotShrinkEastSide": 3, "DoNotShrinkNorthSide": 4}, selected="DoNotShrinkWestSide")
# ToEdge or not: If ToEdge is true, ShrinkSurfaceToEdge() is used, same as Rhino command "ShrinkTrimmedSrfToEdge", which shrinks the surface right to the trimming boundaries. Note, having the edges so close to the trimming boundaries can cause failure during commands that use the surface edges as input.
# If ToEdge is false, ShrinkFace() is used, same as Rhino command "ShrinkTrimmedSrf", in which case user can specify one of the four edges to skip shrinking.
toedge = BooleanToggle(False)
flipu = BooleanToggle(True)
flipv = BooleanToggle(False)
smooth = BooleanToggle(False)
# Flip surface U/V
srf = Surface(<surface referenced from the Rhino model>)
# Shrink surface
srf_2 = Surface(<surface referenced from the Rhino model>)
list_2 = ValueList({"North": 3, "East": 4, "West": 5, "South": 6}, selected="South")
# Swap surface U&V
srf_3 = Surface(<surface referenced from the Rhino model>)
srf_4 = Surface(<surface referenced from the Rhino model>)
# Extend surface
srf_5 = Surface(<surface referenced from the Rhino model>)
flipuv = CSharpScript(S0=srf, FlipU=flipu, FlipV=flipv)  # -> S; inputs S0: Surface, FlipU: Boolean, FlipV: Boolean
# ---------- flipuv: C# ----------
    if (FlipU)
      S0.Reverse(0, true);
    if (FlipV)
      S0.Reverse(1, true);
    S = S0;
# ---------- end flipuv ----------
shrink = CSharpScript(S0=srf_2, Sides=list, ToEdge=toedge)  # -> S; inputs S0: Brep, Sides: Int32, ToEdge: Boolean
# ---------- shrink: C# ----------
    if (ToEdge)
      S0.Faces[0].ShrinkSurfaceToEdge();
    else
      S0.Faces[0].ShrinkFace((BrepFace.ShrinkDisableSide) Sides);
    S = S0;
# ---------- end shrink ----------
swapuv = CSharpScript(S=srf_3)  # -> T; inputs S: Surface
# ---------- swapuv: C# ----------
    T = S.Transpose();
# ---------- end swapuv ----------
shrink_2 = CSharpScript(S0=srf_4)  # -> S; inputs S0: Brep
# ---------- shrink_2: C# ----------
    S0.Faces[0].ShrinkFace(0);
    S = S0;
# ---------- end shrink_2 ----------
extendsrf = CSharpScript(S=srf_5, Edge=list_2, Length=Slider(0.518, range=0..1), Smooth=smooth)  # -> E; inputs S: Surface, Edge: Int32, Length: Double, Smooth: Boolean
# ---------- extendsrf: C# ----------
    E = S.Extend((IsoStatus) Edge, Length, Smooth);
# ---------- end extendsrf ----------
srf_6 = Surface(swapuv)
srf_7 = Surface(shrink_2)
srf_8 = Surface(flipuv)
srf_9 = Surface(shrink)
srf_10 = Surface(extendsrf)
# Mesh
# Mesh from closed polyline
panel_21 = Panel("")
# Offset distance: Offset distance can be negative value, which leads to the offset in direction opposite to mesh normal.
offset_distance = Slider(2, range=0..10)
solid = BooleanToggle(True)
meshpoly = CSharpScript()  # -> M; inputs P: Polyline
# ---------- meshpoly: C# ----------
    M = Mesh.CreateFromClosedPolyline(P);
# ---------- end meshpoly ----------
# Mesh offset
mesh = Mesh()
meshoffset = CSharpScript(M=mesh, D=offset_distance, S=solid)  # -> OM; inputs M: Mesh, D: Double, S: Boolean
# ---------- meshoffset: C# ----------
    OM = M.Offset(D, S);
# ---------- end meshoffset ----------
# Object
panel_23 = Panel("")
geo = Geometry()
geo_2 = Geometry()
geo_3 = Geometry()
# Usage: [Input]
# Can be both geometry and GUID
# [Output]
# N=object name
# L=object layer name
# P=object layer full path
guid = Guid()
guid_2 = Guid()
# Get Rhino object attributes
geo_4 = Geometry()
layer_name = Panel("Defaults")
# Bake object to layer
bake = Button()
layer_name_2 = Panel("""layer_1
layer_2""")
bake_2 = Button()
entwine = Entwine(Branch00=geo, Branch01=geo_2, FlattenInputs=True)
geo_5 = Geometry()
getatt = CSharpScript(ID=[geo_4, guid_2])  # -> N, L; inputs ID: Guid
# ---------- getatt: C# ----------
    Rhino.DocObjects.RhinoObject obj = doc.Objects.Find(ID);

    N = obj.Name;
    int i = obj.Attributes.LayerIndex;
    L = doc.Layers.FindIndex(i).Name;
# ---------- end getatt ----------
getatt_2 = CSharpScript(ID=[geo_3, guid])  # -> N, L, P; inputs ID: Guid
# ---------- getatt_2: C# ----------
    var doc = RhinoDoc.ActiveDoc;
    RhinoObject obj = doc.Objects.Find(ID);

    N = obj.Name;
    int i = obj.Attributes.LayerIndex;
    L = doc.Layers.FindIndex(i).Name;
    P = doc.Layers.FindIndex(i).FullPath;
# ---------- end getatt_2 ----------
layerbake = CSharpScript(b=bake, G=geo_5, L=layer_name)  # -> A; inputs b: Boolean, G: GeometryBase, L: String
# ---------- layerbake: C# usings ----------
using System.IO;
using System.Linq;
using System.Data;
using System.Drawing;
using System.Reflection;
using System.Windows.Forms;
using System.Xml;
using System.Xml.Linq;
using System.Runtime.InteropServices;

using Rhino.DocObjects;
using Rhino.Collections;
using GH_IO;
using GH_IO.Serialization;
# ---------- layerbake: C# ----------
    if(b)
    {
      ObjectAttributes oa = new ObjectAttributes();
      oa.LayerIndex = doc.Layers.FindName(L).Index;
      doc.Objects.Add(G, oa);
    }
# ---------- end layerbake ----------

# ---- group: multiple layers
layerbake_2 = CSharpScript(b=bake_2, G=entwine, L=graft(layer_name_2))  # -> A; inputs b: Boolean, G: GeometryBase, L: String; same code as layerbake

# ----
# Usage: [Input]
# N = layer name
# P = layer full path
# Only one of these two input are required.
# If P gets input value, N is neglected.
# 
# The geometry pipeline retrieves all objects in the Rhino document and applies a layer filter afterward. However, this approach results in a significant decrease in performance for documents that contain numerous objects.
# 
# This component retrieves objects directly using the LayerIndexFilter, which prevents such performance issues.
# 
# [Output]
# ID = object id in a list
# T = object type in a list
panel_27 = Panel("ParentLayer::ChildLayer1")
# Layer
# Find layer by wildcard pattern
# Usage: [Input]
# Layer = Exact match
# Layer*
# *Layer
# *Layer*
# Layer::*
# *::Layer
# *::Layer::*
# 
# Grasshopper Geometry Pipeline components also use wildcard pattern as layer input.
# Wildcard pattern details:
# https://en.wikipedia.org/wiki/Matching_wildcards
# 
# [Output]
# N=layer name
# P=layer full path
panel_28 = Panel("""Layer
Layer*
*Layer
*Layer*
Layer::*
*::Layer
*::Layer::*""")
# Get object from layer
panel_29 = Panel("Layer")
findlayer = CSharpScript(L=panel_28)  # -> N, P; inputs L: String
# ---------- findlayer: C# usings ----------
using Microsoft.VisualBasic;
using Microsoft.VisualBasic.CompilerServices;
# ---------- findlayer: C# ----------
    int n = doc.Layers.Count;
    int i;
    string layerpath;

    List<string> namelist = new List<string>();
    List<string> pathlist = new List<string>();

    List<bool> blist = new List<bool>();
    for (i = 0;i < n;i++)
      if (doc.Layers[i].IsValid)
      {
        layerpath = doc.Layers[i].FullPath;
        if (LikeOperator.LikeString(layerpath, L, CompareMethod.Text))
        {
          pathlist.Add(layerpath);
          namelist.Add(doc.Layers[i].Name);
        }

      }
    P = pathlist;
    N = namelist;
# ---------- end findlayer ----------
layerobj = CSharpScript(N=panel_29)  # -> ID, T; inputs N: String, P: String
# ---------- layerobj: C# ----------
    var doc = RhinoDoc.ActiveDoc;
    ObjectEnumeratorSettings st = new ObjectEnumeratorSettings();
    int i;
    if (P != null)
      i = doc.Layers.FindByFullPath(P, 0);
    else
      i = doc.Layers.FindName(N).Index;
    st.LayerIndexFilter = i;
    st.HiddenObjects = true;
    st.LockedObjects = true;
    IEnumerable<RhinoObject> goolist = doc.Objects.GetObjectList(st);
    List<Guid> idlist = new List<Guid>();
    List<string> typelist = new List<string>();
    foreach (RhinoObject item in goolist)
    {
      idlist.Add(item.Id);
      typelist.Add(item.GetType().Name);
    }
    ID = idlist;
    T = typelist;
# ---------- end layerobj ----------
layerobj_2 = CSharpScript(N=panel_27)  # -> ID, T; inputs N: String, P: String; same code as layerobj
# Others
panel_31 = Panel("")
# Unload grasshopper
# Usage 1: Sometimes GH lost its focus, combination key with "Ctrl" and single key like "Delete" signal always come to Rhino. Use this component to reload GH without restarting Rhino.
# Usage 2: For plugin developer who wants to reload GHA file without restarting Rhino.
# 
# 1: In GH preference set your plugin load mechanism to "copy to memory", restart Rhino to activate the new mechanism.
# 2: In Visual Studio build the GHA file.
# 3: Use this component to unload GH without restarting Rhino. It is recommended to delete boolean input and make this component a custom object in toolbar. In this way everytime the component is put on canvas through toolbar drag or F4 search, GH will be unloaded instantly. Note: If there are C# component in current GH file, a warning may pop out.
# 4: Run grasshopper command again in Rhino.
unload_gh = Button()
c_script = CSharpScript(b=unload_gh, TooltipDescriptionOverride="Unload grasshopper while keep Rhino alive", TooltipTextOverride="Unload GH")  # inputs b: Boolean
# ---------- c_script: C# ----------
    if(b)
      Grasshopper.Instances.UnloadAllObjects();
# ---------- end c_script ----------
